# Grasshopper definition line reader.gh (Grasshopper 1.0.7)
# plug-ins: Pufferfish, Noise 4D

path = FilePath("C:\Users\shabe\OneDrive\Documents\iaac\sem13\studio\unityRecord\tony_record_0.csv")
path_2 = FilePath("C:\Users\shabe\OneDrive\Documents\iaac\sem13\studio\unityRecord\")
panel = Panel("""15
31
32
60
63
66
65
69""")
num = Number(0.1169915958)
python = GhPythonScript(x=path_2, y=num, z=Slider(0, range=0..200))  # -> out, a, b; inputs z: Int32
# ---------- python: Python ----------
__author__ = "shabe"
__version__ = "2021.06.19"

import rhinoscriptsyntax as rs
import re
import os
import sys
import random
allLines = []
ys = []

files = os.listdir(x)
path  = x + files[z] 
with open(path,"r") as file:
    
    for line in file:
        print (random.random()-1)/1000000
        if re.findall("<Line",line):
            locline = []
        elif re.findall("Line>",line):
            allLines.append(locline)
        else:
            line = line.replace("||","")
            try:
                line = line.split(",")
                pt = rs.AddPoint(float(line[0]),float(line[1]),float(line[2]))
                ys.append(float(line[2]))
                locline.append(pt)
            except:
                print ("pass",line)
plines = []

for ln in allLines:
    plines.append(rs.AddCurve(ln,1))
a  = plines
b = sum(ys)/len(ys)
# ---------- end python ----------
number_slider = Slider(4, range=0..10)
number_slider_2 = Slider(69, range=0..160)
number_slider_3 = Slider(99, range=0..100)
brec = BoundingRectangle(Geometry=flatten(python.a), Plane=PlaneXY(0, 0, 0), Axis=0, Slide=0, Union=True)  # -> Bounding, DimensionX, DimensionY
sqgrid = Square(Plane=PlaneXY(0, 0, 0), Size=Slider(0.25, range=0..1), ExtentX=5, ExtentY=5)  # -> Cells, Points
tstat = TreeStatistics(Tree=python.a)  # -> Paths, Length, Count
area = Area(Geometry=brec.Bounding)  # -> Area, Centroid
area_2 = Area(Geometry=sqgrid.Cells)  # -> Area, flatten(Centroid)
lng = ListLength(List=python.a)
branch = TreeBranch(Tree=simplify(python.a), Path="0", MaintainPaths=True)
end = EndPoints(Curve=python.a)  # -> Start, End
series = Series(Start=0, Step=1, Count=lng)
pt = Point(Point(0, 0, 0.05))
move = Move(Geometry=end.End, Motion=pt)  # -> Geometry, Transform
explode = Explode(Curve=python.a, Recursive=True)  # -> Segments, Vertices
perlin = PerlinNoise(Values=explode.Vertices, Time=series, Scale=Slider(0.0223, range=0.0001..1))
move2pt = MoveToPoint(Geometry=python.a, PointA=area.Centroid, PointB=graft(area_2.Centroid))  # -> Moved, Vector, Transform
move_2 = Move(Geometry=end.Start, Motion=pt)  # -> Geometry, Transform
Z = UnitZ(Factor=perlin)
move_3 = Move(Geometry=explode.Vertices, Motion=Z)  # -> Geometry, Transform
merge = Merge(Data1=simplify(graft(move_2.Geometry)), Data2=simplify(move_3.Geometry), Data3=simplify(graft(move.Geometry)))
pline = PolyLine(Vertices=merge, Closed=False)
